# Dynamo graph dynamo_bridge.dyn (Dynamo 2.0.3.8810)

# group: Girder Input
number_of_girders = DoubleSlider(6, range=2..20 step 1)
girder_size = FamilyTypes(index=1130)
overhang = DoubleInput(3)
min_haunch = DoubleInput(0.167)
girder_deck_joint_offset = DoubleInput(0.25)

# group: Beam Properties
parameters = Element.Parameters(element=girder_size)
code_block = CodeBlock(param=parameters) { param[8]; param[3]; }
beam_depth = Parameter.Value(parameter=code_block.out0)
beam_width = Parameter.Value(parameter=code_block.out1)

# group: Basic Geometry Input
alignment_curve = DSModelElementSelection()  # 1 picked in the model
pier_layout = CodeBlock()
# ---------- pier_layout.designscript (7 lines) ----------
// Define your spans in this code block
// Use a list with size of each span in ft
// Set last span = -1 to fill out the distance
// E.G. for three spans with the first is 50 ft
// second is 30 ft and the last remaining
// distince would be [ 50, 30, -1 ]
spans = [ 25, 50, -1 ];
# ----------------------------------------
number_of_spans = IntegerSlider(4, range=1..20 step 1)
calculate_pier_locations_python = Python(IN[0]=number_of_spans)
# ---------- calculate_pier_locations_python.python (23 lines) ----------
# Enable Python support and load DesignScript library
import clr
clr.AddReference('ProtoGeometry')
from Autodesk.DesignScript.Geometry import *

# The inputs to this node will be stored as a list in the IN variables.
dataEnteringNode = IN

# Place your code below this line
pier_count = IN[0] - 1
# start abutment is at 0
pier_loc = [ 0.0 ]

# add piers at even spaced intervals
if pier_count > 0:
	for i in range(0, pier_count):
		pier_loc.append((i + 1.0)  / (pier_count + 1.0))
		
# end abutment is at 1
pier_loc.append(1.0)

# Assign your output to the OUT variable.
OUT = pier_loc
# ----------------------------------------
code_block_2 = CodeBlock(Bearing_Lines=pier_layout, Equal_Lines=calculate_pier_locations_python) { Bearing_Lines; Equal_Lines; }
file_path = Filename("\\corp.ads\data\Content\content\Shared\Revit\2019\NA-EN\Family_Templates\English_I\Generic Model.rft")

# group: Basic Geometry
curvesFromCADLayers = CAD.CurvesFromCADLayers(importInstance=alignment_curve)
python_script = Python(IN[0]=curvesFromCADLayers.Curve, IN[1]=code_block_2.Bearing_Lines)
# ---------- python_script.python (26 lines) ----------
# Enable Python support and load DesignScript library
import clr
clr.AddReference('ProtoGeometry')
from Autodesk.DesignScript.Geometry import *

# The inputs to this node will be stored as a list in the IN variables.
dataEnteringNode = IN

# Place your code below this line

# input values
curve = IN[0][0][0]
spans = IN[1]

curve_len = curve.Length
span_dist = [ 0.0 ]
i = 0.0
for s in spans:
	if s == -1:
		span_dist.append(1.0)
	else:
		i += s
		span_dist.append(i / curve_len)

# Assign your output to the OUT variable.
OUT = span_dist
# ----------------------------------------
pointAtParameter = Curve.PointAtParameter(curve=curvesFromCADLayers.Curve, param=python_script, lacing=Longest)
flatten = List.Flatten(list=pointAtParameter)
code_block_3 = CodeBlock(UpperCurvePoints=flatten) { UpperCurvePoints; }
XY = Plane.XY()
pullOntoPlane = Curve.PullOntoPlane(curve=curvesFromCADLayers.Curve, plane=XY)
X = Point.X(point=pointAtParameter)
Y = Point.Y(point=pointAtParameter)
byCoordinates = Point.ByCoordinates(x=X, y=Y)
parameterAtPoint = Curve.ParameterAtPoint(curve=pullOntoPlane, point=byCoordinates, lacing=Longest)
normalAtParameter = Curve.NormalAtParameter(curve=pullOntoPlane, param=parameterAtPoint, lacing=Longest)
ZAxis = Vector.ZAxis()
byOriginXAxisYAxis = Plane.ByOriginXAxisYAxis(origin=code_block_3, xAxis=normalAtParameter, yAxis=ZAxis)
flatten_2 = List.Flatten(list=byOriginXAxisYAxis)

# group: Deck Input
deck_width = DoubleInput(30)
deck_slope_left = DoubleInput(0)
deck_slope_right = DoubleInput(0)
deck_thickness = DoubleInput(0.667)

# group: Deck
deck_points_python = Python(IN[0]=code_block_3, IN[1]=flatten_2, IN[2]=deck_width, IN[3]=deck_slope_left, IN[4]=deck_slope_right, IN[5]=number_of_girders, IN[6]=overhang)
# ---------- deck_points_python.python (68 lines) ----------
# Enable Python support and load DesignScript library
import clr
clr.AddReference('ProtoGeometry')
from Autodesk.DesignScript.Geometry import *

# The inputs to this node will be stored as a list in the IN variables.
dataEnteringNode = IN

# Place your code below this line
# a simple function 
def join_list(lst1, lst2):
	lst = []
	for itm in lst1:
		lst.append(itm)
	for itm in reversed(lst2):
		lst.append(itm)
	return lst

# genenerates a list of points for a bearing line
def gen_bearing(crown_pnt, perp_XAxis, width, slope_left, slope_right, girders):
	# list of points to return
	deck = []
	# sets up two points that are at each deck end shifted in the z-axis by the slope
	pnt_1 = Geometry.Translate(crown_pnt, perp_XAxis, -width)
	pnt_1 = Geometry.Translate(pnt_1, Vector.ZAxis(), slope_left*width)
	pnt_2 = Geometry.Translate(crown_pnt, perp_XAxis, width)
	pnt_2 = Geometry.Translate(pnt_2, Vector.ZAxis(), slope_right*width)
	
	# start at the left end
	deck.append(pnt_1)
	
	# create the points from left to right, one point at each girder location and one point at the crown if there is an event number of girders
	g_pnts_h = [ Geometry.Translate(crown_pnt, perp_XAxis, g-width) for g in girders ]
	for i in range(len(girders)):
		if girders[i] < width:
			deck.append(Geometry.Translate(g_pnts_h[i], Vector.ZAxis(), slope_left*(width-girders[i])))
		elif girders[i] > width:
			if i > 0 and girders[i - 1] < width:
				deck.append(crown_pnt)
			deck.append(Geometry.Translate(g_pnts_h[i], Vector.ZAxis(), slope_right*(girders[i] - width)))
		elif girders[i] == width:
			deck.append(crown_pnt)
			
	deck.append(pnt_2)
	return deck

# input values
bearing_lines = IN[0]
perp_planes = IN[1]
width = IN[2]/2.0
slope_left = IN[3]
slope_right = IN[4]
girder_cnt = IN[5]
overhang = IN[6]

# calculate girder spacing and determine girder locations
spacing = (width*2.0 - 2.0 * overhang) / (girder_cnt - 1)
girder_loc = [ overhang + i * spacing for i in range(int(girder_cnt)) ]

# calculate all of the points at each bearing line
bearing_rect = [ gen_bearing(bearing_lines[i], perp_planes[i].XAxis, width, slope_left, slope_right, girder_loc) for i in range(len(bearing_lines)) ]

# we join two bearing lines to a single list so that a surface can be 
# created for each deck segment
spans = [ join_list(bearing_rect[i], bearing_rect[i+1]) for i in range(len(bearing_rect) - 1) ]

# Assign your output to the OUT variable.
OUT = spans
# ----------------------------------------
ZAxis_2 = Vector.ZAxis()
code_block_4 = CodeBlock(x=deck_thickness) { -x; }
translate = Geometry.Translate(geometry=deck_points_python, direction=ZAxis_2, distance=code_block_4)
deck_surface_python = Python(IN[0]=curvesFromCADLayers.Curve, IN[1]=deck_width)
# ---------- deck_surface_python.python (29 lines) ----------
# Enable Python support and load DesignScript library
import clr
clr.AddReference('ProtoGeometry')
from Autodesk.DesignScript.Geometry import *

# The inputs to this node will be stored as a list in the IN variables.
dataEnteringNode = IN

# Place your code below this line
curve = IN[0][0][0]
width = IN[1] / 2.0

# some vector math so that we can move the curve to form the boundaries
low_curve = Curve.PullOntoPlane(curve, Plane.XY())
normals = [ Curve.NormalAtParameter(low_curve, 0.0), Curve.NormalAtParameter(low_curve, 1.0) ]
s_plane = Plane.ByOriginXAxisYAxis(curve.StartPoint, normals[0], Vector.ZAxis()) 
e_plane = Plane.ByOriginXAxisYAxis(curve.EndPoint, normals[1], Vector.ZAxis())

# building the cross section
l_start = Geometry.Translate(s_plane.Origin, s_plane.XAxis, -width)
s_cross = Line.ByStartPointDirectionLength(l_start, s_plane.XAxis, 2.0 * width)
l_end = Geometry.Translate(e_plane.Origin, e_plane.XAxis, -width)
e_cross = Line.ByStartPointDirectionLength(l_end, e_plane.XAxis, 2.0 * width)

# build the deck surface
deck_surf = PolySurface.ByLoft([s_cross, e_cross], curve)

# Assign your output to the OUT variable.
OUT = deck_surf
# ----------------------------------------
code_block_5 = CodeBlock(x=deck_thickness) { -x; }
code_block_6 = CodeBlock { false; }
thicken = Surface.Thicken(surface=deck_surface_python, thickness=code_block_5, both_sides=code_block_6)
categories = Categories(index=87)
byGeometry = DirectShape.ByGeometry(geometry=thicken, category=categories)

# group: Girders
girder_lines_start_phyton = Python(IN[0]=number_of_girders, IN[1]=beam_depth, IN[2]=translate, IN[3]=min_haunch, IN[4]=girder_deck_joint_offset)
# ---------- girder_lines_start_phyton.python (44 lines) ----------
# Enable Python support and load DesignScript library
import clr
clr.AddReference('ProtoGeometry')
from Autodesk.DesignScript.Geometry import *

# The inputs to this node will be stored as a list in the IN variables.
dataEnteringNode = IN

# Place your code below this line
# Returns the start points of each girder at a bearing line to be feed into Line.ByStartPointEndPoint
def gen_girderlines(deck_pnts, girder_cnt, depth, haunch):
	# this section determines where in the list are girder points and not just deck end points or crown point (if even # of girders)
	start_pnt = 1
	end_pnt = int(4 + girder_cnt*2 if girder_cnt % 2 == 0 else girder_cnt*2 + 2)
	# We need to setup a plane parrallel to the girder so that we can offset it from the bearing line
	dir_vector = Vector.ByTwoPoints(deck_pnts[start_pnt], deck_pnts[end_pnt]).Normalized()
	dir = Plane.ByOriginNormal(deck_pnts[start_pnt], dir_vector)
	dir_vector = Vector.Rotate(dir_vector, dir.YAxis, 90)
	dir = Plane.ByOriginNormal(deck_pnts[start_pnt], dir_vector)
	
	# creates a list of points at the girders and applies the joint offset
	girders = []
	while(start_pnt <= (girder_cnt + 1 if girder_cnt % 2 == 0 else girder_cnt)):
		if girder_cnt % 2 == 0 and start_pnt == girder_cnt / 2 + 1:
			start_pnt += 1
			continue
		girder = Geometry.Translate(deck_pnts[start_pnt], Vector.ZAxis(), -haunch)
		girder = Geometry.Translate(girder, dir.XAxis, -joint)
		start_pnt += 1
		girders.append(girder)
	return girders

#input values
girder_cnt = IN[0]
beam_depth = IN[1]
deck_geo = IN[2]
haunch = IN[3]
joint = IN[4]

# get the girder points at each bearing line
girder_lines = [ gen_girderlines(deck_line, girder_cnt, beam_depth, haunch) for deck_line in deck_geo ]

# Assign your output to the OUT variable.
OUT = girder_lines
# ----------------------------------------
girder_lines_end_python = Python(IN[0]=number_of_girders, IN[1]=beam_depth, IN[2]=translate, IN[3]=min_haunch, IN[4]=girder_deck_joint_offset)
# ---------- girder_lines_end_python.python (46 lines) ----------
# Enable Python support and load DesignScript library
import clr
clr.AddReference('ProtoGeometry')
from Autodesk.DesignScript.Geometry import *

# The inputs to this node will be stored as a list in the IN variables.
dataEnteringNode = IN

# Place your code below this line
# Returns the start points of each girder at a bearing line to be feed into Line.ByStartPointEndPoint
def gen_girderlines(deck_pnts, girder_cnt, depth, haunch):
	# this section determines where in the list are girder points and not just deck end points or crown point (if even # of girders)
	start_pnt = 1
	end_pnt = int(4 + girder_cnt*2 if girder_cnt % 2 == 0 else girder_cnt*2 + 2)
	# We need to setup a plane parrallel to the girder so that we can offset it from the bearing line
	dir_vector = Vector.ByTwoPoints(deck_pnts[start_pnt], deck_pnts[end_pnt]).Normalized()
	dir = Plane.ByOriginNormal(deck_pnts[end_pnt], dir_vector)
	dir_vector = Vector.Rotate(dir_vector, dir.YAxis, 90)
	dir = Plane.ByOriginNormal(deck_pnts[end_pnt], dir_vector)
	
	# creates a list of points at the girders and applies the joint offset
	girders = []
	while(start_pnt <= (girder_cnt + 1 if girder_cnt % 2 == 0 else girder_cnt)):
		if girder_cnt % 2 == 0 and start_pnt == girder_cnt / 2 + 1:
			start_pnt += 1
			end_pnt -= 1
			continue
		girder = Geometry.Translate(deck_pnts[end_pnt], Vector.ZAxis(), -haunch)
		girder = Geometry.Translate(girder, dir.XAxis, joint)
		start_pnt += 1
		end_pnt -= 1
		girders.append(girder)
	return girders

#input values
girder_cnt = IN[0]
beam_depth = IN[1]
deck_geo = IN[2]
haunch = IN[3]
joint = IN[4]

# get the girder points at each bearing line
girder_lines = [ gen_girderlines(deck_line, girder_cnt, beam_depth, haunch) for deck_line in deck_geo ]

# Assign your output to the OUT variable.
OUT = girder_lines
# ----------------------------------------
byStartPointEndPoint = Line.ByStartPointEndPoint(startPoint=girder_lines_start_phyton, endPoint=girder_lines_end_python)
levels = Levels(index=0)
beamByCurve = StructuralFraming.BeamByCurve(curve=byStartPointEndPoint, level=levels, structuralFramingType=girder_size)

# group: Pier Input
bearing_thickness = DoubleInput(0.5)
min_pedestal_thickness = DoubleInput(0.25)
bottom_of_foundation_elevation = DoubleInput(-4)
pier_width = DoubleInput(3)
foundation_height = DoubleInput(2)
foundation_wdith = DoubleInput(6)
bearing_length = DoubleInput(1)

# group: Bearings
normalAtParameter_2 = Curve.NormalAtParameter(curve=byStartPointEndPoint, lacing=Longest)
byOriginXAxisYAxis_2 = Plane.ByOriginXAxisYAxis(origin=girder_lines_start_phyton, xAxis=normalAtParameter_2)
normalAtParameter_3 = Curve.NormalAtParameter(curve=byStartPointEndPoint, lacing=Longest)
byOriginXAxisYAxis_3 = Plane.ByOriginXAxisYAxis(origin=girder_lines_end_python, xAxis=normalAtParameter_3)
beam_properties = CodeBlock(beam_depth=beam_depth, beam_width=beam_width) { beam_depth; beam_width; }
bearing_geometry_python = Python(IN[0]=byOriginXAxisYAxis_2, IN[1]=beam_properties.beam_depth, IN[2]=beam_properties.beam_width, IN[3]=bearing_length, IN[4]=bearing_thickness)
# ---------- bearing_geometry_python.python (44 lines) ----------
# Enable Python support and load DesignScript library
import clr
clr.AddReference('ProtoGeometry')
from Autodesk.DesignScript.Geometry import *
import math

# The inputs to this node will be stored as a list in the IN variables.
dataEnteringNode = IN

# Place your code below this line

# returns a list of points for the bearing location
def cube_pnts(girder_plane, beam_depth, beam_width, bearing_len, bearing_thk):
	# for some reason dynamo reverses the the normal direction of plane at the bearings for half the planes so we need ensure all reference planes have the same normal for when the bearing surface receives its thickness
	if girder_plane.Normal.Z < 0:
		girder_plane = Plane.ByOriginNormalXAxis(girder_plane.Origin, Vector.ByCoordinates(0,0,1), girder_plane.XAxis)
	
	# shift the first point to the start location underneath the girder
	origin = girder_plane.Origin
	origin = Geometry.Translate(origin, Vector.ZAxis(), -(beam_depth+bearing_thk))
	# generate the four points for bearing pad
	cube = []
	cube.append(Geometry.Translate(origin, girder_plane.XAxis, -beam_depth/2.0))
	cube.append(Geometry.Translate(cube[0], girder_plane.XAxis, beam_depth))
	cube.append(Geometry.Translate(cube[1], girder_plane.YAxis, bearing_len))
	cube.append(Geometry.Translate(cube[2], girder_plane.XAxis, -beam_depth))
	return cube

# input values
bl_start = IN[0]
beam_depth = IN[1]
beam_width = IN[2]
bearing_len = IN[3]
bearing_thk = IN[4]

# generate a bearing at each girder of each bearing line
bearings = []
for bl in bl_start:
	for b in bl:
		bearings.append(cube_pnts(b, beam_depth, beam_width, bearing_len, bearing_thk))


# Assign your output to the OUT variable.
OUT = bearings
# ----------------------------------------
byPerimeterPoints = Surface.ByPerimeterPoints(points=bearing_geometry_python)
code_block_7 = CodeBlock { false; }
thicken_2 = Surface.Thicken(surface=byPerimeterPoints, thickness=bearing_thickness, both_sides=code_block_7)
categories_2 = Categories(index=85)
pedestal_name_pyhton = Python(IN[0]=bearing_geometry_python)
# ---------- pedestal_name_pyhton.python (16 lines) ----------
# Enable Python support and load DesignScript library
import clr
clr.AddReference('ProtoGeometry')
from Autodesk.DesignScript.Geometry import *

# The inputs to this node will be stored as a list in the IN variables.
dataEnteringNode = IN

# Place your code below this line

ped_list = IN[0]

names = [ "BrgStart" + str(i) for i in range(len(ped_list)) ]

# Assign your output to the OUT variable.
OUT = names
# ----------------------------------------
byGeometry_2 = DirectShape.ByGeometry(geometry=thicken_2, category=categories_2, name=pedestal_name_pyhton)
bearing_geometry_python_2 = Python(IN[0]=byOriginXAxisYAxis_3, IN[1]=beam_properties.beam_depth, IN[2]=beam_properties.beam_width, IN[3]=bearing_length, IN[4]=bearing_thickness)
# ---------- bearing_geometry_python_2.python (44 lines) ----------
# Enable Python support and load DesignScript library
import clr
clr.AddReference('ProtoGeometry')
from Autodesk.DesignScript.Geometry import *
import math

# The inputs to this node will be stored as a list in the IN variables.
dataEnteringNode = IN

# Place your code below this line

# returns a list of points for the bearing location
def cube_pnts(girder_plane, beam_depth, beam_width, bearing_len, bearing_thk):
	# for some reason dynamo reverses the the normal direction of plane at the bearings for half the planes so we need ensure all reference planes have the same normal for when the bearing surface receives its thickness
	if girder_plane.Normal.Z < 0:
		girder_plane = Plane.ByOriginNormalXAxis(girder_plane.Origin, Vector.ByCoordinates(0,0,1), girder_plane.XAxis)
	
	# shift the first point to the start location underneath the girder
	origin = girder_plane.Origin
	origin = Geometry.Translate(origin, Vector.ZAxis(), -(beam_depth+bearing_thk))
	# generate the four points for bearing pad
	cube = []
	cube.append(Geometry.Translate(origin, girder_plane.XAxis, -beam_depth/2.0))
	cube.append(Geometry.Translate(cube[0], girder_plane.XAxis, beam_depth))
	cube.append(Geometry.Translate(cube[1], girder_plane.YAxis, bearing_len))
	cube.append(Geometry.Translate(cube[2], girder_plane.XAxis, -beam_depth))
	return cube

# input values
bl_end = IN[0]
beam_depth = IN[1]
beam_width = IN[2]
bearing_len = IN[3]
bearing_thk = IN[4]

# generate a bearing at each girder of each bearing line
bearings = []
for bl in bl_end:
	for b in bl:
		bearings.append(cube_pnts(b, beam_depth, beam_width, -1*bearing_len, bearing_thk))


# Assign your output to the OUT variable.
OUT = bearings
# ----------------------------------------
byPerimeterPoints_2 = Surface.ByPerimeterPoints(points=bearing_geometry_python_2)
code_block_8 = CodeBlock(x=bearing_thickness) { -x; }
code_block_9 = CodeBlock { false; }
thicken_3 = Surface.Thicken(surface=byPerimeterPoints_2, thickness=code_block_8, both_sides=code_block_9)
pedestal_name_pyhton_2 = Python(IN[0]=bearing_geometry_python_2)
# ---------- pedestal_name_pyhton_2.python (16 lines) ----------
# Enable Python support and load DesignScript library
import clr
clr.AddReference('ProtoGeometry')
from Autodesk.DesignScript.Geometry import *

# The inputs to this node will be stored as a list in the IN variables.
dataEnteringNode = IN

# Place your code below this line

ped_list = IN[0]

names = [ "BrgEnd" + str(i) for i in range(len(ped_list)) ]

# Assign your output to the OUT variable.
OUT = names
# ----------------------------------------
byGeometry_3 = DirectShape.ByGeometry(geometry=thicken_3, category=categories_2, name=pedestal_name_pyhton_2)

# group: Piers
top_of_pier_elevations_python = Python(IN[0]=byOriginXAxisYAxis_2, IN[1]=byOriginXAxisYAxis_3, IN[2]=min_haunch, IN[3]=beam_properties.beam_depth, IN[4]=bearing_thickness, IN[5]=deck_thickness, IN[6]=min_pedestal_thickness)
# ---------- top_of_pier_elevations_python.python (36 lines) ----------
# Enable Python support and load DesignScript library
import clr
clr.AddReference('ProtoGeometry')
from Autodesk.DesignScript.Geometry import *

# The inputs to this node will be stored as a list in the IN variables.
dataEnteringNode = IN

# Place your code below this line

# input values
pier_start = IN[0][1:len(IN[0])] # remove the abutment info
pier_end = IN[1][0:len(IN[1])-1] # remove the abutment info
beam_haunch = IN[2]
beam_depth = IN[3]
bearing_thk = IN[4]
deck_thk = IN[5]
ped_thk = IN[6]

# caluclate the top seat of pier elevation
el = []
for i in range(len(pier_start)):
	el.append(pier_start[i][0].Origin.Z)
	for j in range(len(pier_start[i])):
		if(el[i] > pier_start[i][j].Origin.Z):
			el[i] = pier_start[i][j].Origin.Z
		if(el[i] > pier_end[i][j].Origin.Z):
			el[i] = pier_end[i][j].Origin.Z

# apply an offset to account for the girder depth, bearing and pedestal
offset = beam_haunch + beam_depth + bearing_thk/2.0 + ped_thk
for i in range(len(el)):
	el[i] -= offset

# Assign your output to the OUT variable.
OUT = el
# ----------------------------------------
pier_geometry_python = Python(IN[0]=flatten_2, IN[1]=deck_width, IN[2]=top_of_pier_elevations_python, IN[3]=bottom_of_foundation_elevation, IN[4]=pier_width, IN[5]=pier_width, IN[6]=foundation_height)
# ---------- pier_geometry_python.python (40 lines) ----------
# Enable Python support and load DesignScript library
import clr
clr.AddReference('ProtoGeometry')
from Autodesk.DesignScript.Geometry import *

# The inputs to this node will be stored as a list in the IN variables.
dataEnteringNode = IN

# Place your code below this line

# returns a list of points for a basic pier with a cap and stem
def pier_gen(pier_plane, top_el, btm_el, deck_width, pier_width, piercap_height):
	origin = pier_plane.Origin
	origin = Geometry.Translate(origin, Vector.ZAxis(), -(origin.Z - top_el))

	pier = []
	pier.append(Geometry.Translate(origin , pier_plane.XAxis, -deck_width/2.0))
	pier.append(Geometry.Translate(pier[0], pier_plane.XAxis, deck_width))
	pier.append(Geometry.Translate(pier[1], pier_plane.YAxis, -piercap_height))
	pier.append(Geometry.Translate(pier[2], pier_plane.XAxis, -(deck_width/2.0 - pier_width/2.0)))
	pier.append(Geometry.Translate(pier[3], pier_plane.YAxis, -(pier[3].Z - btm_el)))
	pier.append(Geometry.Translate(pier[4], pier_plane.XAxis, -pier_width))
	pier.append(Geometry.Translate(pier[5], pier_plane.YAxis, (pier[3].Z - btm_el)))
	pier.append(Geometry.Translate(pier[6], pier_plane.XAxis, -(deck_width/2.0 - pier_width/2.0)))
	return pier

# input values
pier_cl = IN[0]
deck_width = IN[1]
top_el = IN[2]
btm_el = IN[3]
pier_width = IN[4]
piercap_height = IN[5]
foundation_thk = IN[6]

# get the geometry for each pier
piers = [ pier_gen(pier_cl[i+1], top_el[i], btm_el+foundation_thk, deck_width, pier_width, piercap_height) for i in range(len(top_el)) ]

# Assign your output to the OUT variable.
OUT = piers
# ----------------------------------------
byPerimeterPoints_3 = Surface.ByPerimeterPoints(points=pier_geometry_python)
thicken_4 = Surface.Thicken(surface=byPerimeterPoints_3, thickness=pier_width)
categories_3 = Categories(index=90)
byGeometry_4 = DirectShape.ByGeometry(geometry=thicken_4, category=categories_3)
pier_foundation_geometry_python = Python(IN[0]=flatten_2, IN[1]=bottom_of_foundation_elevation, IN[2]=foundation_height, IN[3]=foundation_wdith)
# ---------- pier_foundation_geometry_python.python (34 lines) ----------
# Enable Python support and load DesignScript library
import clr
clr.AddReference('ProtoGeometry')
from Autodesk.DesignScript.Geometry import *

# The inputs to this node will be stored as a list in the IN variables.
dataEnteringNode = IN

# Place your code below this line

# returns a list of points for the foundation at the piers
def pierfnd_gen(pier_plane, top_el, btm_el, fnd_width):
	origin = pier_plane.Origin
	origin = Geometry.Translate(origin, Vector.ZAxis(), -(origin.Z - top_el))

	pier_fnd = []
	pier_fnd.append(Geometry.Translate(origin , pier_plane.XAxis, -(fnd_width/2.0)))
	pier_fnd.append(Geometry.Translate(pier_fnd[0], pier_plane.XAxis, fnd_width))
	pier_fnd.append(Geometry.Translate(pier_fnd[1], pier_plane.YAxis, -(top_el - btm_el)))
	pier_fnd.append(Geometry.Translate(pier_fnd[2], pier_plane.XAxis, -fnd_width))
	return pier_fnd

# input values
pier_cl = IN[0]
fnd_btm_el = IN[1]
fnd_thk = IN[2]
fnd_width = IN[3]
top_el = fnd_btm_el + fnd_thk

# get the pier foundation geometry at each pier
piers = [ pierfnd_gen(pier_cl[i+1], top_el, fnd_btm_el, fnd_width) for i in range(len(pier_cl)-2) ]

# Assign your output to the OUT variable.
OUT = piers
# ----------------------------------------
byPerimeterPoints_4 = Surface.ByPerimeterPoints(points=pier_foundation_geometry_python)
thicken_5 = Surface.Thicken(surface=byPerimeterPoints_4, thickness=foundation_wdith)
categories_4 = Categories(index=88)
byGeometry_5 = DirectShape.ByGeometry(geometry=thicken_5, category=categories_4)

# group: Abutment Input
start_abutment_bottom_elevation = DoubleInput(0)
backwall_thickness = DoubleInput(0.5)
end_abutment_bottom_elevation = DoubleInput(0.5)
foundation_overhang = DoubleInput(1)
foundation_height_2 = DoubleInput(2)

# group: Abutments
top_of_bridge_seat_elevations = Python(IN[0]=byOriginXAxisYAxis_2, IN[1]=byOriginXAxisYAxis_3, IN[2]=min_haunch, IN[3]=beam_properties.beam_depth, IN[4]=bearing_thickness, IN[5]=min_pedestal_thickness)  # "Top of Bridge Seat Elevations - Python"
# ---------- top_of_bridge_seat_elevations.python (34 lines) ----------
# Enable Python support and load DesignScript library
import clr
clr.AddReference('ProtoGeometry')
from Autodesk.DesignScript.Geometry import *

# The inputs to this node will be stored as a list in the IN variables.
dataEnteringNode = IN

# Place your code below this line

# input values
abut_start = IN[0][0]
abut_end = IN[1][len(IN[1])-1]
beam_haunch = IN[2]
beam_depth = IN[3]
bearing_thk = IN[4]
ped_thk = IN[5]

# find the top of abutment seat at each abutment by finding the girder at the lowest elevation
el = [ 100000, 100000]
for i in abut_start:
	if(el[0] > i.Origin.Z):
		el[0] = i.Origin.Z
for i in abut_end:
	if(el[1] > i.Origin.Z):
		el[1] = i.Origin.Z

# apply an offset to account for the beam depth, bearing and pedestal
offset = beam_haunch + beam_depth + bearing_thk/2.0 + ped_thk
for i in range(len(el)):
	el[i] -= offset

# Assign your output to the OUT variable.
OUT = el
# ----------------------------------------
bridge_seat_geometry_python = Python(IN[0]=flatten_2, IN[1]=deck_width, IN[2]=top_of_bridge_seat_elevations, IN[3]=start_abutment_bottom_elevation)
# ---------- bridge_seat_geometry_python.python (33 lines) ----------
# Enable Python support and load DesignScript library
import clr
clr.AddReference('ProtoGeometry')
from Autodesk.DesignScript.Geometry import *

# The inputs to this node will be stored as a list in the IN variables.
dataEnteringNode = IN

# Place your code below this line

# generate the bridge seat geometry
def abut_gen(abut_plane, top_el, btm_el, deck_width):
	origin = abut_plane.Origin
	origin = Geometry.Translate(origin, Vector.ZAxis(), -(origin.Z - top_el))
	
	abut = []
	abut.append(Geometry.Translate(origin , abut_plane.XAxis, -deck_width/2.0))
	abut.append(Geometry.Translate(abut[0], abut_plane.XAxis, deck_width))
	abut.append(Geometry.Translate(abut[1], abut_plane.YAxis, -(abut[1].Z - btm_el)))
	abut.append(Geometry.Translate(abut[2], abut_plane.XAxis, -deck_width))
	return abut

# input values
abut_cl = IN[0]
deck_width = IN[1]
top_el = IN[2]
start_btm_el = IN[3]

# get the abutment seat geomentry for the abutment
abut = abut_gen(abut_cl[0], top_el[0], start_btm_el, deck_width)

# Assign your output to the OUT variable.
OUT = abut
# ----------------------------------------
byPerimeterPoints_5 = Surface.ByPerimeterPoints(points=bridge_seat_geometry_python)
code_block_10 = CodeBlock(x=pier_width) { x/2; }
code_block_11 = CodeBlock { false; }
thicken_6 = Surface.Thicken(surface=byPerimeterPoints_5, thickness=code_block_10, both_sides=code_block_11)
categories_5 = Categories(index=83)
byGeometry_6 = DirectShape.ByGeometry(geometry=thicken_6, category=categories_5)
back_wall_geometry_python = Python(IN[0]=flatten_2, IN[1]=deck_width, IN[2]=deck_points_python, IN[3]=start_abutment_bottom_elevation)
# ---------- back_wall_geometry_python.python (34 lines) ----------
# Enable Python support and load DesignScript library
import clr
clr.AddReference('ProtoGeometry')
from Autodesk.DesignScript.Geometry import *

# The inputs to this node will be stored as a list in the IN variables.
dataEnteringNode = IN

# Place your code below this line

# returns a list of points for the abutment backwall
def abut_gen(abut_plane, top_crown, btm_el, deck_width):
	# the top points match the shape of the bridge deck
	abut = top_crown[:]
	last = len(abut)-1
	# the bottom points are tied to the bottom elevation
	abut.append(Geometry.Translate(abut[last] , abut_plane.YAxis, -(abut[last].Z - btm_el)))
	abut.append(Geometry.Translate(abut[len(abut)-1], abut_plane.XAxis, -deck_width))
	return abut

# input values
abut_cl = IN[0]
deck_width = IN[1]
top_crown = IN[2]
start_btm_el = IN[3]

# gets the top of deck points
start_top_crown = top_crown[0][:len(top_crown[0])/2]

# get the backwall geometry
abut = abut_gen(abut_cl[0], start_top_crown, start_btm_el, deck_width)

# Assign your output to the OUT variable.
OUT = abut
# ----------------------------------------
byPerimeterPoints_6 = Surface.ByPerimeterPoints(points=back_wall_geometry_python)
code_block_12 = CodeBlock(x=backwall_thickness) { -x; }
code_block_13 = CodeBlock { false; }
thicken_7 = Surface.Thicken(surface=byPerimeterPoints_6, thickness=code_block_12, both_sides=code_block_13)
categories_6 = Categories(index=83)
byGeometry_7 = DirectShape.ByGeometry(geometry=thicken_7, category=categories_6)
bridge_seat_geometry_python_2 = Python(IN[0]=flatten_2, IN[1]=deck_width, IN[2]=top_of_bridge_seat_elevations, IN[3]=end_abutment_bottom_elevation)
# ---------- bridge_seat_geometry_python_2.python (33 lines) ----------
# Enable Python support and load DesignScript library
import clr
clr.AddReference('ProtoGeometry')
from Autodesk.DesignScript.Geometry import *

# The inputs to this node will be stored as a list in the IN variables.
dataEnteringNode = IN

# Place your code below this line

# generate the bridge seat geometry
def abut_gen(abut_plane, top_el, btm_el, deck_width):
	origin = abut_plane.Origin
	origin = Geometry.Translate(origin, Vector.ZAxis(), -(origin.Z - top_el))
	
	abut = []
	abut.append(Geometry.Translate(origin , abut_plane.XAxis, -deck_width/2.0))
	abut.append(Geometry.Translate(abut[0], abut_plane.XAxis, deck_width))
	abut.append(Geometry.Translate(abut[1], abut_plane.YAxis, -(abut[1].Z - btm_el)))
	abut.append(Geometry.Translate(abut[2], abut_plane.XAxis, -deck_width))
	return abut

# input values
abut_cl = IN[0]
deck_width = IN[1]
top_el = IN[2]
end_btm_el = IN[3]

# get the abutment seat geomentry for the abutment
abut = abut_gen(abut_cl[len(abut_cl)-1], top_el[1], end_btm_el, deck_width)

# Assign your output to the OUT variable.
OUT = abut
# ----------------------------------------
byPerimeterPoints_7 = Surface.ByPerimeterPoints(points=bridge_seat_geometry_python_2)
code_block_14 = CodeBlock(x=pier_width) { -x/2; }
code_block_15 = CodeBlock { false; }
thicken_8 = Surface.Thicken(surface=byPerimeterPoints_7, thickness=code_block_14, both_sides=code_block_15)
categories_7 = Categories(index=83)
byGeometry_8 = DirectShape.ByGeometry(geometry=thicken_8, category=categories_7)
back_wall_geometry_python_2 = Python(IN[0]=flatten_2, IN[1]=deck_width, IN[2]=deck_points_python, IN[3]=end_abutment_bottom_elevation)
# ---------- back_wall_geometry_python_2.python (39 lines) ----------
# Enable Python support and load DesignScript library
import clr
clr.AddReference('ProtoGeometry')
from Autodesk.DesignScript.Geometry import *

# The inputs to this node will be stored as a list in the IN variables.
dataEnteringNode = IN

# Place your code below this line

# returns a list of points for the abutment backwall
def abut_gen(abut_plane, top_crown, btm_el, deck_width):
	# the top points match the shape of the bridge deck
	abut = top_crown[:]
	last = len(abut)-1
	# the bottom points are tied to the bottom elevation
	abut.append(Geometry.Translate(abut[last] , abut_plane.YAxis, -(abut[last].Z - btm_el)))
	abut.append(Geometry.Translate(abut[len(abut)-1], abut_plane.XAxis, -deck_width))
	return abut

# input value
abut_cl = IN[0]
deck_width = IN[1]
top_crown = IN[2]
end_btm_el = IN[3]

# gets the top of deck points
start_top_crown = top_crown[0][:len(top_crown[0])/2]
end_top_crown_rev = top_crown[len(top_crown)-1][len(top_crown[0])/2:]
end_top_crown = []
# for the end abutment we need to reverse the points in order to create a valid surface geometry
for pnt in reversed(end_top_crown_rev):
	end_top_crown.append(pnt)

# get the backwall geometry
abut = abut_gen(abut_cl[len(abut_cl)-1], end_top_crown, end_btm_el, deck_width)

# Assign your output to the OUT variable.
OUT = abut
# ----------------------------------------
byPerimeterPoints_8 = Surface.ByPerimeterPoints(points=back_wall_geometry_python_2)
code_block_16 = CodeBlock { false; }
thicken_9 = Surface.Thicken(surface=byPerimeterPoints_8, thickness=backwall_thickness, both_sides=code_block_16)
categories_8 = Categories(index=83)
byGeometry_9 = DirectShape.ByGeometry(geometry=thicken_9, category=categories_8)
abutment_foundation_geometry = Python(IN[0]=flatten_2, IN[1]=deck_width, IN[2]=foundation_overhang, IN[3]=pier_width, IN[4]=backwall_thickness, IN[5]=start_abutment_bottom_elevation, IN[6]=end_abutment_bottom_elevation)  # "Abutment Foundation Geometry - Python"
# ---------- abutment_foundation_geometry.python (42 lines) ----------
# Enable Python support and load DesignScript library
import clr
clr.AddReference('ProtoGeometry')
from Autodesk.DesignScript.Geometry import *

# The inputs to this node will be stored as a list in the IN variables.
dataEnteringNode = IN

# Place your code below this line

# returns a list of points for the abutment foundation
def abutfnd_gen(abut_plane, top_el, deck_width, overhang, abut_width, bw_width, dir):
	# we need to rotate the abutment plane because the shape is not guarenteed to be symmetrical at the origin of the plane
	xaxis = Vector.ByCoordinates(abut_plane.Normal.X, abut_plane.Normal.Y, 0)
	yaxis = Vector.ByCoordinates(abut_plane.Normal.Y, abut_plane.Normal.X, 0)
	plane = Plane.ByOriginXAxisYAxis(abut_plane.Origin, xaxis, yaxis)

	origin = plane.Origin
	origin = Geometry.Translate(origin, Vector.ZAxis(), -(origin.Z - top_el))
	origin = Geometry.Translate(origin , plane.YAxis, -(deck_width/2.0 + overhang))

	abut_fnd = []
	abut_fnd.append(Geometry.Translate(origin , plane.XAxis, dir*(overhang + bw_width)))
	abut_fnd.append(Geometry.Translate(abut_fnd[0], plane.YAxis, deck_width + overhang * 2))
	abut_fnd.append(Geometry.Translate(abut_fnd[1], plane.XAxis, -dir*(overhang * 2 + abut_width + bw_width)))
	abut_fnd.append(Geometry.Translate(abut_fnd[2], plane.YAxis, -(deck_width + overhang * 2)))
	return abut_fnd

# input values
abut_cl = IN[0]
deck_width = IN[1]
fnd_overhang = IN[2]
abut_width = float(IN[3])/2
backwall_width = IN[4]
start_btm_el = IN[5]
end_btm_el = IN[6]

# get the geometry for the start and end abutment foundations
abut = [ abutfnd_gen(abut_cl[0], start_btm_el, deck_width, fnd_overhang, abut_width, backwall_width, 1), abutfnd_gen(abut_cl[len(abut_cl)-1], end_btm_el, deck_width, fnd_overhang, abut_width, backwall_width, -1) ]

# Assign your output to the OUT variable.
OUT = abut
# ----------------------------------------
byPerimeterPoints_9 = Surface.ByPerimeterPoints(points=abutment_foundation_geometry)
code_block_17 = CodeBlock(x=foundation_height_2) { [-x,x]; }
code_block_18 = CodeBlock { false; }
thicken_10 = Surface.Thicken(surface=byPerimeterPoints_9, thickness=code_block_17, both_sides=code_block_18)
categories_9 = Categories(index=88)
byGeometry_10 = DirectShape.ByGeometry(geometry=thicken_10, category=categories_9)

# group: Pedestals
top_of_pier_abut_elevations = Python(IN[0]=byOriginXAxisYAxis_2, IN[1]=byOriginXAxisYAxis_3, IN[2]=min_haunch, IN[3]=beam_properties.beam_depth, IN[4]=bearing_thickness, IN[5]=min_pedestal_thickness)  # "Top of Pier/Abut Elevations - Python"
# ---------- top_of_pier_abut_elevations.python (42 lines) ----------
# Enable Python support and load DesignScript library
import clr
clr.AddReference('ProtoGeometry')
from Autodesk.DesignScript.Geometry import *

# The inputs to this node will be stored as a list in the IN variables.
dataEnteringNode = IN

# Place your code below this line

# input values
pier_start = IN[0]
pier_end = IN[1]
beam_haunch = IN[2]
beam_depth = IN[3]
bearing_thk = IN[4]
ped_thk = IN[5]

# to find the top of pier and top of bridge seat elevations we loop through each girder/bearing and find the lowest elevation girder/bearing at each abutment and either side of the pier and select that as the elevation
el = []
for i in range(len(pier_start)+1):
	if i != len(pier_start):
		# the span start value
		el.append(pier_start[i][0].Origin.Z)
	else:
		# the span end value
		el.append(pier_end[i-1][0].Origin.Z)
	for j in range(len(pier_start[0])):
		# check the span start
		if(i != len(pier_start) and el[i] > pier_start[i][j].Origin.Z):
			el[i] = pier_start[i][j].Origin.Z
		# check the span end
		if(i != 0 and el[i] > pier_end[i-1][j].Origin.Z):
			el[i] = pier_end[i-1][j].Origin.Z

# apply a universal offset to account for the beam, bearing and pedestal
offset = beam_haunch + beam_depth + bearing_thk/2.0 + ped_thk
for i in range(len(el)):
	el[i] -= offset

# Assign your output to the OUT variable.
OUT = el
# ----------------------------------------
pedestals_geometry_python = Python(IN[0]=flatten_2, IN[1]=deck_width, IN[2]=top_of_pier_abut_elevations, IN[3]=pier_width, IN[4]=number_of_girders, IN[5]=overhang)
# ---------- pedestals_geometry_python.python (108 lines) ----------
# Enable Python support and load DesignScript library
import clr
clr.AddReference('ProtoGeometry')
from Autodesk.DesignScript.Geometry import *

# The inputs to this node will be stored as a list in the IN variables.
dataEnteringNode = IN

# Place your code below this line

# returns a list of points for the pedestal
def rect_pnts(ped_plane, top_el, ped_width, girder_spa):
	origin = ped_plane.Origin
	origin = Geometry.Translate(origin, Vector.ZAxis(), -(origin.Z - top_el))
	rect = []
	rect.append(Geometry.Translate(origin, ped_plane.XAxis, girder_spa/2.0))
	rect.append(Geometry.Translate(rect[0], ped_plane.YAxis, ped_width))
	rect.append(Geometry.Translate(rect[1], ped_plane.XAxis, -girder_spa))
	rect.append(Geometry.Translate(rect[2], ped_plane.YAxis, -ped_width))
	return rect

# returns a list of for the pedestal when the girder is at the overhang
def rect_pnts_endgirders(ped_plane, top_el, ped_width, girder_spa, overhang, dir):
	origin = ped_plane.Origin
	origin = Geometry.Translate(origin, Vector.ZAxis(), -(origin.Z - top_el))
	rect = []
	
	rect.append(Geometry.Translate(origin, ped_plane.XAxis, dir*overhang))
	rect.append(Geometry.Translate(rect[0], ped_plane.YAxis, ped_width))
	rect.append(Geometry.Translate(rect[1], ped_plane.XAxis, -dir*(overhang + girder_spa/2.0)))
	rect.append(Geometry.Translate(rect[2], ped_plane.YAxis, -ped_width))
	
	# we need to reverse the points at one overhang end so that the geometery has the same normal direction
	if dir < 0:
		rect_rev = []
		for r in reversed(rect):
			rect_rev.append(r)
		return rect_rev
	
	return rect

# input values
brg_cl = IN[0]
deck_width = IN[1]
top_el = IN[2]
pier_width = IN[3]
girder_cnt = IN[4]
overhang = IN[5]

# caluclate girder spacing and pedestal width
girder_spa = (deck_width - 2.0 * overhang) / (girder_cnt - 1)
ped_width = pier_width/2.0

pedestals = []
# run for start of span girder lines first
for i in range(len(brg_cl)-1):
	# every iteration shifts to the next girder along the spacing
	loc = -(deck_width/2.0 - overhang)
	loc_vec = Geometry.Translate(brg_cl[i].Origin, brg_cl[i].XAxis, loc)
	g = 1;
	while g <= girder_cnt:
		plane = Plane.ByOriginXAxisYAxis(loc_vec, brg_cl[i].XAxis, brg_cl[i].YAxis)
		dir_vec = Vector.ByCoordinates(0, 0, 1)
		plane = Plane.ByOriginNormalXAxis(plane.Origin, dir_vec, plane.XAxis)
		
		if g == 1:
			# get geometry for left overhang pedestal
			pedestals.append(rect_pnts_endgirders(plane, top_el[i], ped_width, girder_spa, overhang, -1))
		elif g == girder_cnt:
			# get geometry for right overhang pedestal
			pedestals.append(rect_pnts_endgirders(plane, top_el[i], ped_width, girder_spa, overhang, 1))
		else:
			# get geometry for interior pedestals
			pedestals.append(rect_pnts(plane, top_el[i], ped_width, girder_spa))
		
		# shift to the next girder
		g += 1
		loc += girder_spa
		loc_vec = Geometry.Translate(brg_cl[i].Origin, brg_cl[i].XAxis, loc)

# now add the end of span girder lines
for i in range(1, len(brg_cl)):
	# every iteration shifts to the next girder along the spacing
	loc = -(deck_width/2.0 - overhang)
	loc_vec = Geometry.Translate(brg_cl[i].Origin, brg_cl[i].XAxis, loc)
	g = 1
	while g <= girder_cnt:
		plane = Plane.ByOriginXAxisYAxis(loc_vec, brg_cl[i].XAxis, brg_cl[i].YAxis)
		dir_vec = Vector.ByCoordinates(0, 0, -1)
		plane = Plane.ByOriginNormalXAxis(plane.Origin, dir_vec, plane.XAxis)
		
		if g == 1:
			# get geometry for left overhang pedestal
			pedestals.append(rect_pnts_endgirders(plane, top_el[i], ped_width, girder_spa, overhang, -1))
		elif g == girder_cnt:
			# get geometry for right overhang pedestal
			pedestals.append(rect_pnts_endgirders(plane, top_el[i], ped_width, girder_spa, overhang, 1))
		else:
			# get geometry for interior pedestals
			pedestals.append(rect_pnts(plane, top_el[i], ped_width, girder_spa))
		
		# shift to the next girder		
		g += 1
		loc += girder_spa
		loc_vec = Geometry.Translate(brg_cl[i].Origin, brg_cl[i].XAxis, loc)

# Assign your output to the OUT variable.
OUT = pedestals
# ----------------------------------------
byPerimeterPoints_10 = Surface.ByPerimeterPoints(points=pedestals_geometry_python)
pedestal_thickness_python = Python(IN[0]=top_of_pier_abut_elevations, IN[1]=bearing_geometry_python, IN[2]=bearing_geometry_python_2)
# ---------- pedestal_thickness_python.python (27 lines) ----------
# Enable Python support and load DesignScript library
import clr
clr.AddReference('ProtoGeometry')
from Autodesk.DesignScript.Geometry import *

# The inputs to this node will be stored as a list in the IN variables.
dataEnteringNode = IN

# Place your code below this line

# input values
btm_el = IN[0]
top_start_el = IN[1]
top_end_el = IN[2]

# find the number of pedestals at each bearing line, could just get the girder count
ped_cnt = len(top_start_el) / (len(btm_el) - 1)

# this takes advantage of integer division to take the top of seat elevation at each bearing line and subtract it from each bearing to find the height of the pedestal
thk = []
for i in range(len(top_start_el)):
	thk.append(top_start_el[i][0].Z - btm_el[int(i/ped_cnt)])
for i in range(len(top_end_el)):
	thk.append(-(top_end_el[i][0].Z - btm_el[int(i/ped_cnt)+1]))

# Assign your output to the OUT variable.
OUT = thk
# ----------------------------------------
code_block_19 = CodeBlock { false; }
thicken_11 = Surface.Thicken(surface=byPerimeterPoints_10, thickness=pedestal_thickness_python, both_sides=code_block_19)
categories_10 = Categories(index=85)
pedestal_name_pyhton_3 = Python(IN[0]=pedestals_geometry_python)
# ---------- pedestal_name_pyhton_3.python (16 lines) ----------
# Enable Python support and load DesignScript library
import clr
clr.AddReference('ProtoGeometry')
from Autodesk.DesignScript.Geometry import *

# The inputs to this node will be stored as a list in the IN variables.
dataEnteringNode = IN

# Place your code below this line

ped_list = IN[0]

names = [ "Pedestal" + str(i) for i in range(len(ped_list)) ]

# Assign your output to the OUT variable.
OUT = names
# ----------------------------------------
byGeometry_11 = DirectShape.ByGeometry(geometry=thicken_11, category=categories_10, name=pedestal_name_pyhton_3)

select_model_elements = DSModelElementsSelection()  # 2 picked in the model
plane = ReferencePlane.Plane(referencePlane=select_model_elements)
intersect = Geometry.Intersect(geometry=plane, other=curvesFromCADLayers.Curve, lacing=Longest)
